# Grasshopper definition DH_DocumentAndLayoutText_Example.gh (Grasshopper 1.0.8)
# plug-ins: RhinoCodePluginGH, DraftHorse

# ----
# DRAFTHORSE
# Access/Edit Document Text
# for consistent project data across layouts
# note: document text keys starting
# with '.' are hidden from the user
panel = Panel("GrasshopperFilePath")
ghdocpath = Script()  # -> dir
# ---------- ghdocpath: C# ----------
// Grasshopper Script Instance
using System;
using System.Collections;
using System.Collections.Generic;
using System.Drawing;

using Rhino;
using Rhino.Geometry;

using Grasshopper;
using Grasshopper.Kernel;
using Grasshopper.Kernel.Data;
using Grasshopper.Kernel.Types;

public class Script_Instance : GH_ScriptInstance
{
  /* 
    Members:
      RhinoDoc RhinoDocument
      GH_Document GrasshopperDocument
      IGH_Component Component
      int Iteration

    Methods (Virtual & overridable):
      Print(string text)
      Print(string format, params object[] args)
      Reflect(object obj)
      Reflect(object obj, string method_name)
  */
  
  private void RunScript(ref object dir)
  {
    string filePath = GrasshopperDocument.FilePath;
    dir = filePath;
  }
}
# ---------- end ghdocpath ----------
# Tools for automating layout creation and modification
# 
# By Jo Kamm
# https://github.com/jkamm/DraftHorse_rh8
# Use with DH_DocumentAndLayoutText_Example.3dm
accessdoctext = AccessDocumentText(Key=panel)
specific_doc_text_value = Panel(accessdoctext)

editdoctext = EditDocumentText(Keys=panel, Values=ghdocpath, WriteMethod="Merge")  # -> Keys, Values

# ----
# Access/Edit Layout Text
# for layout specific data
# "Edit Layout" Used here
# only to access Layout attributes
layout = PageLayout(<page layout referenced from the Rhino model>)
newvalues = Panel("""1:1
3/4 Baltic Birch
10
Kitchen Casework
1""")

# ----
# See Layout Template for use of Text Fields with Document and Layout Text
# primary use of this component is for
# programmatic baking to Layouts
# (use in combination with Bake component
# from Elefront, Human, or other plugin set)
layout_2 = PageLayout(layout)
active_page = MakePageActive(Page=layout_2)  # -> Result, Name

layoutedit = EditLayout(LayoutPage=layout)  # -> LayoutPage, Index, Name, Width, Height, Keys, Values

# ----
# Or Edit Named Text Objects on a Layout
layout_3 = PageLayout(layout)
lotext = ModifyText(Run=False, LayoutPage=layout_3, Name="PageTitle", Text="Hello World!")

item = ListItem(List=layoutedit.Keys, Index=0, Wrap=True)
values = Panel(layoutedit.Values)
keys = Panel(layoutedit.Keys)
layoutedit_2 = EditLayout(LayoutPage=layout, Keys=layoutedit.Keys, Values=newvalues)  # -> LayoutPage, Index, Name, Width, Height, Keys, Values

getlovalue = AccessLayoutUserText(Page=layout, Keys=item)

specific_value = Panel(getlovalue)
